# Grasshopper definition test_plugin_output_preview_single_rc8.10.ghx (Grasshopper 1.0.8)
# plug-ins: ScriptInstancePreviews.GH

number_slider = Slider(1, range=0..1)
outpreviewscriptwithpreview = OutPreviewScriptWithPreview(X=number_slider, Y=number_slider)
outpreviewsdkwithpreview = OutPreviewSDKWithPreview(X=number_slider, Y=number_slider)
panel = Panel(outpreviewsdkwithpreview)
panel_2 = Panel(outpreviewscriptwithpreview)

# ---- group: Expected Previews
image_sampler = ImageSampler(
    FilePath="C:\Users\ein\LEO-WX\Downloads\_sharex\Rhino_hJFcd5semv.png",
    Filter="Colour",
    Interpolate=False,
    Umax=1,
    Umin=0,
    Vmax=1,
    Vmin=0,
    Wrap=1)

# ----
outpreviewscriptnopreview = OutPreviewScriptNoPreview(X=number_slider, Y=number_slider)
outpreviewsdknopreview = OutPreviewSDKNoPreview(X=number_slider, Y=number_slider)
panel_3 = Panel(outpreviewscriptnopreview)
panel_4 = Panel(outpreviewsdknopreview)
