# Grasshopper definition test_ghscript_xref_remote.ghx (Grasshopper 1.0.8)
# plug-ins: RhinoCodePluginGH

panel = Panel("https://github.com/mcneel/rhinocodetests/raw/main/files/gh1/test_self.gh")
S = Script(Script=panel)  # -> Out, Result
python = GhPythonScript(checks=flatten(S.Result))  # -> all_true; inputs checks: list
# ---------- python: Python ----------
all_true = all(checks)
# ---------- end python ----------
panel_2 = Panel(python)
context_bake = ContextBake(Content=python)
