# Grasshopper definition test_package_restore.ghx (Grasshopper 1.0.8)
# plug-ins: RhinoCodePluginGH

python3numpy = RhinoCode()  # -> a
# ---------- python3numpy: Python ----------
"""Python 3 with Numpy"""
# requirements: numpy

import numpy as np

# numpy array with random values
a = list(np.random.rand(7))
# ---------- end python3numpy ----------
csharprestsharp = RhinoCode()  # -> a
# ---------- csharprestsharp: C# ----------
// Default C# Script with Nuget package

#r "nuget: RestSharp, 106.11.7"

using System;
using System.Collections.Generic;
using Rhino;

using RestSharp;
using RestSharp.Authenticators;

var client = new RestClient("https://httpbin.org");
var request = new RestRequest("get", DataFormat.Json);
var response = client.Get(request);

a = response.Content;
# ---------- end csharprestsharp ----------
list_length = ListLength(List=python3numpy)
match_text = MatchText(Text=csharprestsharp, RegEx="\\\"https:\\/\\/httpbin\\.org\\/get\\\"", Case=True)
equality = Equality(FirstNumber=list_length, SecondNumber=Slider(7, range=0..10))  # -> Equality, Inequality
gate_and = GateAnd(A=equality.Equality, B=match_text)
context_bake = ContextBake(Content=gate_and)
panel = Panel(gate_and)
