# Grasshopper definition test_params_context_python3_scriptinstance_global_diagnose_rc8.8.ghx (Grasshopper 1.0.8)
# plug-ins: RhinoCodePluginGH

panel = Panel("""#! python 3
import System
import Rhino
import Grasshopper

import rhinoscriptsyntax as rs

print(x)
print(y)
print(k)

class MyComponent(Grasshopper.Kernel.GH_ScriptInstance):
    def RunScript(self, x, y):
        return""")
panel_2 = Panel("""undefined name 'x'
undefined name 'k'""")
python = GhPythonScript(script=panel, WARN=Toggle(False), INFO=Toggle(False), HINT=Toggle(False))  # -> diags; inputs WARN: Boolean, INFO: Boolean, HINT: Boolean
# ---------- python: Python ----------
import clr
clr.AddReference('Rhino.Runtime.Code')
from Rhino.Runtime.Code import RhinoCode, Param
from Rhino.Runtime.Code.Languages import DiagnoseOptions

code = RhinoCode.CreateCode(script)

x_param = Param("x")
x_param.AutoDeclare = False
code.Inputs.Add(x_param)

code.Inputs.Add("y")

opts = DiagnoseOptions()
opts.Errors = True
opts.Warnings = WARN
opts.Infos = INFO
opts.Hints = HINT

diags = list(code.Diagnose(opts))
print(diags)
# ---------- end python ----------
panel_3 = Panel(python)
tmatch = MatchText(Text=python, RegEx=panel_2, Case=True)
assert_true = AssertTrue(tmatch)
