# Grasshopper definition test_params_outputs_point3dList_convert.ghx (Grasshopper 1.0.8)
# plug-ins: RhinoCodePluginGH

pt = Point([Point(-8, -27, 0), Point(-25, -7, 0), Point(-20, 8, 0), Point(-1, 36, 0), Point(17, 17, 0), Point(4, -8, 0)])
pt_2 = Point([Point(-8, -27, 0), Point(-25, -7, 0), Point(-20, 8, 0), Point(-1, 36, 0), Point(17, 17, 0), Point(4, -8, 0)])
# Output has Point3dList converter
entwine = Entwine(Branch00=pt, Branch01=pt_2, FlattenInputs=True)

# ---- group: OUTPUT
python_3_script = Python3Script(points=[pt, pt_2])  # -> polyline; inputs points: list
# ---------- python_3_script: Python ----------
from Rhino.Geometry import Polyline, PolylineCurve
polyline = Polyline(points)
polylineCurve = PolylineCurve(points)
# ---------- end python_3_script ----------
python_3_script_2 = Python3Script(points=entwine)  # -> polyline; inputs points: list; same code as python_3_script
pt_3 = Point(python_3_script_2)
pt_4 = Point(python_3_script)
panel = Panel(pt_4)
panel_2 = Panel(pt_3)

# ----
panel_3 = Panel("""6
6""")
lng = ListLength(List=pt_3)
equals = Equality(FirstNumber=lng, SecondNumber=panel_3)  # -> Equality, Inequality
lng_2 = ListLength(List=pt_4)
lng_3 = ListLength(List=pt_3)
equals_2 = Equality(FirstNumber=lng_3, SecondNumber=panel_3)  # -> Equality, Inequality
equals_3 = Equality(FirstNumber=lng_2, SecondNumber="12")  # -> Equality, Inequality

# ---- group: ALSO NO ERRORS ON PARAMS
python = GhPythonScript(checks=flatten([equals.Equality, equals_2.Equality, equals_3.Equality]))  # -> all_true; inputs checks: list
# ---------- python: Python ----------
all_true = all(checks)
# ---------- end python ----------
panel_4 = Panel(python)
context_bake = ContextBake(Content=python)
