# Grasshopper definition test_params_python_marshallGuid.ghx (Grasshopper 1.0.8)
# plug-ins: RhinoCodePluginGH

sph = Sphere(Base=PlaneXY(0, 0, 0), Radius=1)
sph_2 = Sphere(Base=PlaneXY(0, 0, 0), Radius=1)

# ---- group: INPUTS ARE MARSHALLED IF USING "ghobject" HINT
python = GhPythonScript(sphere=sph)  # -> out, a
# ---------- python: Python ----------
print(type(sphere))
a = sphere
# ---------- end python ----------
python_2 = GhPythonScript(sphere=sph)  # -> out, a; same code as python

# ---- group: NO MARSHALL ON "No Type Hint"
python_3 = GhPythonScript(sphere=sph_2)  # -> out, a; same code as python
python_4 = GhPythonScript(sphere=sph_2)  # -> out, a; same code as python

# ----
panel = Panel(python.out)
panel_2 = Panel(python.a)
panel_3 = Panel(python_3.out)

# ---- group: AVOID MARSH OUT
panel_4 = Panel(python_2.out)
panel_5 = Panel(python_2.a)
id = Guid(python_2.a)

panel_6 = Panel(python_4.out)
panel_7 = Panel(python_4.a)

# ----
python_5 = GhPythonScript(sphere=id)  # -> out, a; same code as python
py3 = Python3Script(sphere=sph)  # -> out, a; same code as python
py3_2 = Python3Script(sphere=sph)  # -> out, a; same code as python
panel_8 = Panel(python_5.out)
panel_9 = Panel(python_5.a)
panel_10 = Panel(py3.out)
panel_11 = Panel(py3.a)
panel_12 = Panel(py3_2.out)
panel_13 = Panel(py3_2.a)
id_2 = Guid(py3_2.a)
py3_3 = Python3Script(sphere=py3_2.a)  # -> out, a; same code as python
panel_14 = Panel(py3_3.out)
panel_15 = Panel(py3_3.a)
