# Grasshopper definition test_params_python_marshallGuid_nested.ghx (Grasshopper 1.0.8)
# plug-ins: RhinoCodePluginGH

python = GhPythonScript(r=Slider(12, range=0..100))  # -> a
# ---------- python: Python ----------
import rhinoscriptsyntax as rs

a = rs.AddSphere((1,1,0), r)
# ---------- end python ----------
py3 = Python3Script(r=Slider(12, range=0..100))  # -> a; same code as python
id = Guid(py3)
py3_2 = Python3Script(x=py3)  # -> out, a
# ---------- py3_2: Python ----------
print(type(x))
a = x
# ---------- end py3_2 ----------
id_2 = Guid(python)
python_2 = GhPythonScript(x=python)  # -> out, a; same code as py3_2
panel = Panel(py3_2.out)
panel_2 = Panel(py3_2.a)
panel_3 = Panel(python_2.out)
panel_4 = Panel(python_2.a)
