# Grasshopper definition components_r7.ghx (Grasshopper 1.0.8)
# plug-ins: RhinoCodePluginGH

first = IronPython2Script()  # -> out, a
# ---------- first: IronPython ----------
"""Grasshopper Script"""
a = "Hello IronPython 2 in Grasshopper!"
print(a)
# ---------- end first ----------
